% Simulink data dictionary RoverA1Interfaces.sldd

BatteryStatus = Simulink.Bus()
  stateOfCharge: double
  temperature: double, Unit="K"

CrsfFrame = Simulink.Bus()
ElectricPower = Simulink.Bus()
Imu = Simulink.Bus()
LaserScan = Simulink.Bus()
ModbusFrame = Simulink.Bus()

NavSatFix = Simulink.Bus()
  horizontalStd: double, Unit="m"

Odometry = Simulink.Bus()
  x: double, Unit="m"
  y: double, Unit="m"
  yaw: double, Unit="rad"

PointCloud2 = Simulink.Bus()

TwistStamped = Simulink.Bus()
  linearX: double, Unit="m/s"
  angularZ: double, Unit="rad/s"

WheelVelocityCommand = Simulink.Bus()
  wheelSpeed: double, Unit="rad/s"